# Dynamo graph Filtering.dyn (Dynamo 2.10.1.3976)

# group: Design Script
boolean = BoolSelector(false)
python_script = Python(IN[0]=boolean)  # IronPython2
# ---------- python_script.python (3 lines) ----------
f = open(r"U:\17_TraningAdvanceDynamo\2_WORKING\Tool\Dynamo\Traning-Dynamo-2024\DesignScript.py", "r")

OUT = f.read() 
# ----------------------------------------
python_script_from_string = PythonStringNode(script=python_script)  # IronPython2; unwired: IN[0], IN[1]

python_script_2 = Python()  # IronPython2; unwired: IN[0]
# ---------- python_script_2.python (25 lines) ----------
# Importing necessary libraries
import clr
clr.AddReference('RevitServices')
clr.AddReference('RevitAPI')
clr.AddReference('RevitNodes')
import Revit
clr.ImportExtensions(Revit.Elements)
clr.ImportExtensions(Revit.GeometryConversion)
from RevitServices.Persistence import DocumentManager
from RevitServices.Transactions import TransactionManager
from Autodesk.Revit.DB import FilteredElementCollector, BuiltInCategory, ElementCategoryFilter

# Getting the current Revit document and view
doc = DocumentManager.Instance.CurrentDBDocument
uidoc = DocumentManager.Instance.CurrentUIApplication.ActiveUIDocument
current_view = uidoc.ActiveView

# Creating a filter to get all columns in the current view
column_filter = ElementCategoryFilter(BuiltInCategory.OST_Structural_Column)

# Collecting all columns in the current view
columns_in_view = FilteredElementCollector(doc, current_view.Id).WherePasses(column_filter).ToElements()

# Output the results
OUT = [column.ToDSType(True) for column in columns_in_view]
# ----------------------------------------
